# Grasshopper definition BodyArchitectures.gh (Grasshopper 0.9.76)

# ---- group: stream out boundary curves
innercrv_0 = Curve(<curve referenced from the Rhino model>)
innercrv_1 = Curve(<curve referenced from the Rhino model>)
outercrv_0 = Curve(<curve referenced from the Rhino model>)
outercrv_1 = Curve(<curve referenced from the Rhino model>)
number_slider = Slider(99, range=0..100)
divide = DivideCurve(Curve=innercrv_0, Count=number_slider, Kinks=False)  # -> Points, Tangents, Parameters
divide_2 = DivideCurve(Curve=innercrv_1, Count=number_slider, Kinks=False)  # -> Points, Tangents, Parameters
divide_3 = DivideCurve(Curve=outercrv_0, Count=number_slider, Kinks=False)  # -> Points, Tangents, Parameters
divide_4 = DivideCurve(Curve=outercrv_1, Count=number_slider, Kinks=False)  # -> Points, Tangents, Parameters
innercrv_0_txt = Panel(divide.Points)
innercrv_1_txt = Panel(divide_2.Points)
outercrv_0_txt = Panel(divide_3.Points)
outercrv_1_txt = Panel(divide_4.Points)

# ---- group: stream profile curves
profile_0 = Curve(<curve referenced from the Rhino model>)
profile_1 = Curve(<curve referenced from the Rhino model>)
profile_2 = Curve(<curve referenced from the Rhino model>)
profile_3 = Curve(<curve referenced from the Rhino model>)
profile_4 = Curve(<curve referenced from the Rhino model>)
number_slider_2 = Slider(25, range=0..100)
divide_5 = DivideCurve(Curve=profile_0, Count=number_slider_2, Kinks=False)  # -> Points, Tangents, Parameters
divide_6 = DivideCurve(Curve=profile_1, Count=number_slider_2, Kinks=False)  # -> Points, Tangents, Parameters
divide_7 = DivideCurve(Curve=profile_2, Count=number_slider_2, Kinks=False)  # -> Points, Tangents, Parameters
divide_8 = DivideCurve(Curve=profile_3, Count=number_slider_2, Kinks=False)  # -> Points, Tangents, Parameters
divide_9 = DivideCurve(Curve=profile_4, Count=number_slider_2, Kinks=False)  # -> Points, Tangents, Parameters
profile_0_txt = Panel(divide_5.Points)
profile_1_txt = Panel(divide_6.Points)
profile_2_txt = Panel(divide_7.Points)
profile_3_txt = Panel(divide_8.Points)
profile_4_txt = Panel(divide_9.Points)

# ----
crv = Curve(<curve referenced from the Rhino model>)
divide_10 = DivideCurve(Curve=crv, Count=Slider(99, range=0..100), Kinks=False)  # -> Points, Tangents, Parameters
panel = Panel(divide_10.Points)
